# Grasshopper definition Explod example object.gh (Grasshopper 1.0.7)
# plug-ins: ExplodingWhale

exampleobject = ExampleObject()
explode = ExplodingWhale(Object=exampleobject)  # -> PublicField, PrivateField, PublicProperty, PrivateProperty
panel = Panel(explode.PublicField)
panel_2 = Panel(explode.PrivateField)
panel_3 = Panel(explode.PublicProperty)
panel_4 = Panel(explode.PrivateProperty)
