# Grasshopper definition Exploding Objects.gh (Grasshopper 1.0.7)
# plug-ins: FemDesign.Grasshopper, ExplodingWhale, BH.UI.Grasshopper

# ----
# This have been internalized successfully
data = Data("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")

pt = Point(Point(0, 0, 0))
crv = Curve(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)
hinged = PointSupportHinged(Point=pt, Identifier="S")
explode = ExplodingWhale(Object=crv)  # -> PointCount, Domain, Dimension, SpanCount, Degree, IsClosed, IsPeriodic, PointAtStart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
explode_2 = Explode(Object=hinged, Component="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")  # -> Name, Group, Directed, Position, Motions, MotionsPlasticityLimits, Rotations, RotationsPlasticityLimits, Guid, Action
explode_3 = Explode(Object=crv, Component="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")  # -> PointCount, Domain, Dimension, SpanCount, Degree, IsClosed, IsPeriodic, PointAtStart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
explode_4 = ExplodingWhale(Object=hinged)  # -> Name, Group, Directed, Position, Motions, MotionsPlasticityLimits, Rotations, RotationsPlasticityLimits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
panel = Panel(explode.Fields)
panel_2 = Panel(explode.Values)
